# Dynamo graph ExportFBX.dyn (Dynamo 1.1.0.2094)

current_document = Custom[Current Document]()  # Retrieves Current Document
exportFBX = Custom[ExportFBX](Document=current_document)  # Exports all elements in 3D View to separate .fbx files.
watch = Watch(exportFBX)
